# Dynamo graph Schedule Template v0.001.dyn (Dynamo 2.0.0.4654)

file_path = Filename(".\Finish Schedule Test Area.xlsx")
file_from_path = FileObject(path=file_path)
string = StringInput("FINISH")
boolean = BoolSelector(true)
importExcel = Data.ImportExcel(file=file_from_path, sheetName=string, readAsStrings=boolean)
watch = Watch(importExcel)
removeNulls = Lists.Manage.RemoveNulls(Data=importExcel)
list_create = List.Create(item0=removeNulls.Cleaned)
number = DoubleInput(1)
flatten = List.Flatten(list=list_create, amt=number)
transpose = List.Transpose(lists=flatten)
boolean_2 = BoolSelector(false)
clean = List.Clean(list=transpose, preserveIndices=boolean_2)
python_script = Python(IN[0]=clean)
# ---------- python_script.python (33 lines) ----------
# Enable Python support and load DesignScript library
import clr
clr.AddReference('ProtoGeometry')
clr.AddReference('Microsoft.Office.Interop.Excel, Version=11.0.0.0, Culture=neutral, PublicKeyToken=71e9bce111e9429c')
from Microsoft.Office.Interop import Excel
from System.Runtime.InteropServices import Excel
from System.Runtime.InteropServices import Marshal
 
from Autodesk.DesignScript.Geometry import *


# The inputs to this node will be stored as a list in the IN variables.
path = IN[0]

# Place your code below this line
ex = Excel.ApplicationClass()
ex.Visible = False;
ex.DisplayAlerts = False
workbook = ex.Workbooks.Open(path)
ws = workbook.Worksheets[1]
x1range = ws.Range["A4", "A7"]
x2range = ws.Range["B4". "B7"]

r1 = x1range.Value2
r2 = x2range.Value2

# Assign your output to the OUT variable.
OUT = r1, r2

ex.ActiveWorkbook.Close(False)
Marshal.ReleaseComObjective(ws)
Marshal.ReleaseComObjective(workbook)
Marshal.ReleaseComObjective(ex)
# ----------------------------------------
python_script_from_string = PythonStringNode(script=python_script)  # unwired: IN[0]
watch_2 = Watch(python_script_from_string)
code_block = CodeBlock { 0; }
getItemAtIndex = List.GetItemAtIndex(index=code_block)  # unwired: list
map = List.Map(f_x=getItemAtIndex)  # unwired: list
removeNulls_2 = Lists.Manage.RemoveNulls(Data=map)
watch_3 = Watch(removeNulls_2.Cleaned)
watch_4 = Watch(clean)
