# Dynamo graph Schedule Template v0.002.dyn (Dynamo 2.0.0.4654)

# group: Reading From Excel and Organizing Lists
file_path = Filename("G:\Team Drives\Kenton Grant Consulting\XX KGC Template\Finish Schedule Test Area.xlsx")
python_excel_read = Python(IN[0]=file_path)
# ---------- python_excel_read.python (52 lines) ----------
# Enable Python support and load DesignScript library
import clr
clr.AddReference('ProtoGeometry')
clr.AddReference('Microsoft.Office.Interop.Excel, Version=11.0.0.0, Culture=neutral, PublicKeyToken=71e9bce111e9429c')
from Microsoft.Office.Interop import Excel
from System.Runtime.InteropServices import Marshal
 
from Autodesk.DesignScript.Geometry import *


# The inputs to this node will be stored as a list in the IN variables.
path = IN[0]

# Place your code below this line
ex = Excel.ApplicationClass()
ex.Visible = False;
ex.DisplayAlerts = False
workbook = ex.Workbooks.Open(path)
ws = workbook.Worksheets[1]
x1range = ws.Range["A4","A7"]
x2range = ws.Range["B4","B7"]
x3range = ws.Range["C4","C7"]
x4range = ws.Range["D4","D7"]
x5range = ws.Range["E4","E7"]
x6range = ws.Range["F4","F7"]
x7range = ws.Range["A10","A13"]
x8range = ws.Range["B10","B13"]
x9range = ws.Range["C10","C13"]
x10range = ws.Range["D10","D13"]
x11range = ws.Range["E10","E13"]
x12range = ws.Range["F10","F13"]

r1 = x1range.Value2
r2 = x2range.Value2
r3 = x3range.Value2
r4 = x4range.Value2
r5 = x5range.Value2
r6 = x6range.Value2
r7 = x7range.Value2
r8 = x8range.Value2
r9 = x9range.Value2
r10 = x10range.Value2
r11 = x11range.Value2
r12 = x12range.Value2

# Assign your output to the OUT variable.
OUT = r1,r2,r3,r4,r5,r6,r7,r8,r9,r10,r11,r12

ex.ActiveWorkbook.Close(False)
Marshal.ReleaseComObject(ws)
Marshal.ReleaseComObject(workbook)
Marshal.ReleaseComObject(ex)
# ----------------------------------------
watch = Watch(python_excel_read)
removeNulls = Lists.Manage.RemoveNulls(Data=watch)
watch_2 = Watch(removeNulls.Cleaned)

# group: Creating Sheeets
code_block = CodeBlock { ["sheet one", "sheet two"]; ["ID-1.0","ID-2.0"]; }
family_types = FamilyTypes(index=28)
python_script = Python(IN[0]=code_block.out0, IN[1]=code_block.out1, IN[2]=family_types)
# ---------- python_script.python (33 lines) ----------
# Enable Python support and load DesignScript library
import clr
clr.AddReference("RevitNodes")
import Revit
clr.ImportExtensions(Revit.Elements)

clr.AddReference("RevitServices")
import RevitServices
clr.AddReference('RevitAPI')
from Autodesk.Revit.DB import *
import Autodesk
import System

from RevitServices.Persistence import DocumentManager
from RevitServices.Transactions import TransactionManager

doc = DocumentManager.Instance.CurrentDBDocument
sheetnames = IN[0]
sheetNumber = IN[1]
titleblock = UnwrapElement(IN[2])
sheetlist = list()

TransactionManager.Instance.EnsureInTransaction(doc)

for number in range(len(sheetNumber)):
	newsheet = ViewSheet.Create(doc,titleblock.Id)
	newsheet.Name = sheetnames[number]
	newsheet.SheetNumber = sheetNumber[number]
	sheetlist.append(newsheet.ToDSType(False))
	
TransactionManager.Instance.TransactionTaskDone

OUT = sheetlist
# ----------------------------------------
